% Simulink data dictionary CAT_797F.sldd

Payload = Simulink.Parameter(0, DataType="fixdt(1,8,0)", Unit="tons")  % Payload machine mass
Machine_Mass = Simulink.Parameter(280, DataType="fixdt(1,8,0)", Unit="tons")  % Machine mass
Cf = Simulink.Parameter(0.5)  % Front Cornering Stiffness Coeficient (From front tire)
Cr = Simulink.Parameter(0.5)  % Rear Cornering Stiffness Coeficient (From rear tire)